% Requirement links of crs_controllerdic.sldd (R2018a)

item 1 links to crs_req_func_spec.slreqx#66: Threshold of brake pressure
item 2 links to crs_req_func_spec.slreqx#65: Integral of PI
item 3 links to crs_req_func_spec.slreqx#70: Minimum Target Speed
item 4 links to crs_req_func_spec.slreqx#64: Propotional of PI
item 5 links to crs_req_func_spec.slreqx#67: Maximum Throttle Value
item 6 links to crs_req_func_spec.slreqx#69: Maximum Target Speed
item 7 links to crs_req_func_spec.slreqx#68: Minimum Throttle Value