% Requirement links of crs_req.slreqx (R2018b)

#10 links to crs_req_func_spec.slreqx#9: #9: Enable Switch Detection
#11 links to crs_req_func_spec.slreqx#7: #7: Cancel Switch Detection
#12 links to crs_req_func_spec.slreqx#8: #8: Set Switch Detection
#19 links to crs_req_func_spec.slreqx#8: #8: Set Switch Detection
#20 links to crs_req_func_spec.slreqx#11: #11: Increment Switch Detection
#20 links to crs_req_func_spec.slreqx#12: #12: Increment Short Switch Detection
#21 links to crs_req_func_spec.slreqx#15: #15: Decrement Switch Detection
#21 links to crs_req_func_spec.slreqx#16: #16: Decrement Short Switch Detection
#22 links to crs_req_func_spec.slreqx#13: #13: Increment Long Switch Detection
#22 links to crs_req_func_spec.slreqx#14: #14: Intermediate state
#23 links to crs_req_func_spec.slreqx#17: #17: Decrement Long Switch Detection
#23 links to crs_req_func_spec.slreqx#18: #18: Intermediate state