% Requirement links of crs_controller.slx (R2018a)

block :12 links to crs_req_func_spec.slreqx#19: #19: Cruise Control Mode
block :137 links to crs_req_func_spec.slreqx#26: #26: Disable conditions
block :168 links to crs_req_func_spec.slreqx#27: #27: Enable conditions
block :19 links to crs_req_func_spec.slreqx#36: #36: Disabling override
block :198 links to crs_req_func_spec.slreqx#30: #30: Repeating previous operation mode
block :199 links to crs_req_func_spec.slreqx#28: #28: Resume conditions
block :21 links to crs_req_func_spec.slreqx#20: #20: Disable Cruise Control system
block :233 links to crs_req_func_spec.slreqx#35: #35: Out of speed range detection
block :241 links to crs_req_func_spec.slreqx#1: #1: Driver Switch Request Handling
block :249 links to crs_req_func_spec.slreqx#7: #7: Cancel Switch Detection
block :25 links to crs_req_func_spec.slreqx#21: #21: Key position is not ON
block :250 links to crs_req_func_spec.slreqx#9: #9: Enable Switch Detection
block :251 links to crs_req_func_spec.slreqx#8: #8: Set Switch Detection
block :252 links to crs_req_func_spec.slreqx#10: #10: Resume Switch Detection
block :254 links to crs_req_func_spec.slreqx#7: #7: Cancel Switch Detection
block :255 links to crs_req_func_spec.slreqx#9: #9: Enable Switch Detection
block :256 links to crs_req_func_spec.slreqx#8: #8: Set Switch Detection
block :257 links to crs_req_func_spec.slreqx#10: #10: Resume Switch Detection
block :258 links to crs_req_func_spec.slreqx#15: #15: Decrement Switch Detection
block :262 links to crs_req_func_spec.slreqx#16: #16: Decrement Short Switch Detection
block :265 links to crs_req_func_spec.slreqx#4: #4: Long Switch recognition
block :265 links to crs_req_func_spec.slreqx#17: #17: Decrement Long Switch Detection
block :266 links to crs_req_func_spec.slreqx#6: #6: Waiting state for Long Decrement switch detection
block :266 links to crs_req_func_spec.slreqx#18: #18: Intermediate state
block :272 links to crs_req_func_spec.slreqx#6: #6: Waiting state for Long Decrement switch detection
block :280 links to crs_req_func_spec.slreqx#3: #3: Avoid repreading commands
block :297 links to crs_req_func_spec.slreqx#11: #11: Increment Switch Detection
block :30 links to crs_req_func_spec.slreqx#22: #22: Gear position is not Drive
block :301 links to crs_req_func_spec.slreqx#12: #12: Increment Short Switch Detection
block :304 links to crs_req_func_spec.slreqx#13: #13: Increment Long Switch Detection
block :305 links to crs_req_func_spec.slreqx#14: #14: Intermediate state
block :320 links to crs_req_func_spec.slreqx#37: #37: Calculate Target Speed and Throttle Value
block :324 links to crs_req_func_spec.slreqx#39: #39: Enabled case
block :325 links to crs_req_func_spec.slreqx#40: #40: Activated case
block :328 links to crs_req_func_spec.slreqx#43: #43: Resume mode
block :329 links to crs_req_func_spec.slreqx#39: #39: Enabled case
block :330 links to crs_req_func_spec.slreqx#40: #40: Activated case
block :331 links to crs_req_func_spec.slreqx#43: #43: Resume mode
block :335 links to crs_req_func_spec.slreqx#40: #40: Activated case
block :341 links to crs_req_func_spec.slreqx#42: #42: Next Target Speed Computation
block :35 links to crs_req_func_spec.slreqx#20: #20: Disable Cruise Control system
block :36 links to crs_req_func_spec.slreqx#23: #23: Brake pressure is higher than brake_threshold
block :360 links to crs_req_func_spec.slreqx#69: #69: Maximum Target Speed
block :360 links to crs_req_func_spec.slreqx#70: #70: Minimum Target Speed
block :366 links to crs_req_func_spec.slreqx#41: #41: Throttle Value Computation
block :376 links to crs_req_func_spec.slreqx#65: #65: Integral of PI
block :377 links to crs_req_func_spec.slreqx#64: #64: Propotional of PI
block :38 links to crs_req_func_spec.slreqx#66: #66: Threshold of brake pressure
block :380 links to crs_req_func_spec.slreqx#68: #68: Minimum Throttle Value
block :380 links to crs_req_func_spec.slreqx#67: #67: Maximum Throttle Value
block :394 links to crs_req_func_spec.slreqx#38: #38: Disabled case
block :400 links to crs_req_func_spec.slreqx#39: #39: Enabled case
block :406 links to crs_req_func_spec.slreqx#43: #43: Resume mode
block :49 links to crs_req_func_spec.slreqx#24: #24: Operation mode determination
block :70 links to crs_req_func_spec.slreqx#34: #34: Decrement and hold mode
block :71 links to crs_req_func_spec.slreqx#31: #31: Increment mode
block :72 links to crs_req_func_spec.slreqx#32: #32: Increment and hold mode
block :73 links to crs_req_func_spec.slreqx#33: #33: Decrement mode
block :75 links to crs_req_func_spec.slreqx#31: #31: Increment mode
block :78 links to crs_req_func_spec.slreqx#33: #33: Decrement mode
block :80 links to crs_req_func_spec.slreqx#32: #32: Increment and hold mode
block :81 links to crs_req_func_spec.slreqx#34: #34: Decrement and hold mode
block :87 links to crs_req_func_spec.slreqx#25: #25: Precedence of mode determination
block :88 links to crs_req_func_spec.slreqx#25: #25: Precedence of mode determination
block :89 links to crs_req_func_spec.slreqx#25: #25: Precedence of mode determination
block :90 links to crs_req_func_spec.slreqx#25: #25: Precedence of mode determination
block :91 links to crs_req_func_spec.slreqx#25: #25: Precedence of mode determination
block :92 links to crs_req_func_spec.slreqx#29: #29: Activate conditions